# Grasshopper definition admin.ghx (Grasshopper 1.0.8)

curves = GetGeometry(AnnotationTypeFilter=0, AtLeast=1, AtMost=2147483647, DeleteInput=False, Filter=1074004029, TreeAccess=True)
admin = GetString(AtLeast=1, AtMost=2147483647, TreeAccess=True)
null_item = NullItem(Item=flatten(curves))  # -> NullFlags, InvalidFlags, Description
cull_pattern = CullPattern(List=flatten(admin), CullPattern=invert(null_item.InvalidFlags))
cull_pattern_2 = CullPattern(List=flatten(curves), CullPattern=invert(null_item.InvalidFlags))
cset = CreateSet(List=cull_pattern)  # -> Set, Map
surface = Surface(cull_pattern_2)
lng = ListLength(List=cset.Set)  # -> expr("x-1", Length)
gradient = Gradient(
    LowerLimit=0,
    UpperLimit=lng,
    Parameter=cset.Map,
    stops=[0: RGB(220, 220, 220), 0.5: RGB(0, 128, 128), 1: RGB(47, 66, 244)])
sort = SortList(Keys=surface, ValuesA=surface, ValuesB=gradient, ValuesC=cull_pattern)  # -> Keys, ValuesA, ValuesB, ValuesC

# ---- group: RH_OUT:Values
txt = Text(flatten(sort.ValuesC))

# ---- group: RH_OUT:Colors
txt_2 = Text(sort.ValuesB)

# ---- group: RH_OUT:Surface
geo = Geometry(sort.ValuesA)
