# Grasshopper definition elevate_buildings.ghx (Grasshopper 1.0.7)

mesh = GetGeometry(AnnotationTypeFilter=0, AtLeast=1, AtMost=2147483647, DeleteInput=False, Filter=1074004029, TreeAccess=True)
buildings = GetGeometry(AnnotationTypeFilter=0, AtLeast=1, AtMost=2147483647, DeleteInput=False, Filter=1074004029, TreeAccess=True)
boundary = GetGeometry(AnnotationTypeFilter=0, AtLeast=1, AtMost=1, DeleteInput=False, Filter=1074004029, TreeAccess=False)
flatten = FlattenTree(Tree=buildings, Path="{0}")
debrep = DeconstructBrep(Brep=flatten)  # -> Faces, Edges, Vertices
pt = Point(debrep.Vertices)
pdecon = Deconstruct(Point=pt)  # -> XComponent, YComponent, ZComponent
bounds = Bounds(Numbers=pdecon.ZComponent)
faceb = FaceBoundaries(Mesh=mesh)
boundary_2 = BoundarySurfaces(Edges=faceb)
deconstruct_domain = DeconstructDomain(Domain=bounds)  # -> Start, End
join = BrepJoin(Breps=boundary_2)  # -> Breps, Closed
equals = Equality(FirstNumber=pdecon.ZComponent, SecondNumber=deconstruct_domain.Start)  # -> Equality, Inequality
dispatch = Dispatch(List=pt, DispatchPattern=equals.Equality)  # -> ListA, ListB
project = Project(Curve=boundary, Brep=join.Breps, Direction=Vector(0, 0, 1))
pt_2 = Point(dispatch.ListA)
project_2 = ProjectPoint(Point=pt_2, Direction="0,0,1", Geometry=mesh)  # -> Point, Index
bbox = BoundingBox(Content=project_2.Point, Plane=PlaneXY(0, 0, 0), UnionBox=True)  # -> Box, Box_2
box = EvaluateBox(Box=bbox.Box, UParameter=0.5, VParameter=0.5, WParameter=0)  # -> flatten(Plane), Point, Include
movetoplane = MoveToPlane(Geometry=flatten, Plane=box.Plane, Above=True, Below=True)  # -> Geometry, Transform
null = NullItem(Item=movetoplane.Geometry)  # -> NullFlags, InvalidFlags, Description
cull = CullPattern(List=movetoplane.Geometry, CullPattern=invert(null.NullFlags))

# ---- group: RH_OUT:Elevated
geo = Geometry(cull)

# ---- group: RH_OUT:UpBound
geo_2 = Geometry(project)
