# Grasshopper definition hob.ghx (Grasshopper 1.0.8)

hob = GetString(AtLeast=1, AtMost=2147483647, TreeAccess=True)
curves = GetGeometry(AnnotationTypeFilter=0, AtLeast=1, AtMost=2147483647, DeleteInput=False, Filter=1074004029, TreeAccess=True)
null_item = NullItem(Item=flatten(curves))  # -> NullFlags, InvalidFlags, Description
cull_pattern = CullPattern(List=flatten(curves), CullPattern=invert(null_item.InvalidFlags))
cull_pattern_2 = CullPattern(List=flatten(hob), CullPattern=invert(null_item.InvalidFlags))
sort = SortList(Keys=cull_pattern_2, ValuesA=cull_pattern)  # -> Keys, ValuesA
cset = CreateSet(List=sort.Keys)  # -> Set, Map
surface = Surface(sort.ValuesA)
lng = ListLength(List=cset.Set)  # -> expr("x-1", Length)
gradient = Gradient(
    LowerLimit=0,
    UpperLimit=lng,
    Parameter=cset.Map,
    stops=[0: RGB(253, 245, 230), 0.5: RGB(205, 92, 92), 1: RGB(128, 0, 0)])

# ---- group: RH_OUT:Values
txt = Text(flatten(sort.Keys))

# ---- group: RH_OUT:Surface
geo = Geometry(surface)

# ---- group: RH_OUT:Colors
txt_2 = Text(gradient)
