# Grasshopper definition sunlight_new.ghx (Grasshopper 1.0.8)

panel = Panel("https://energyplus-weather.s3.amazonaws.com/southwest_pacific_wmo_region_5/AUS/AUS_NSW.Sydney.947680_RMY/AUS_NSW.Sydney.947680_RMY.zip")
brep = Brep(<brep referenced from the Rhino model>)
brep_2 = Brep(<brep referenced from the Rhino model>)
downloadepw = LBDownloadWeather(weather_URL=panel)  # -> epw_file, stat_file, ddy_file; plug-in component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
geo = GetGeometry(brep_2, AnnotationTypeFilter=3966, AtLeast=1, AtMost=2147483647, DeleteInput=False, Filter=1074081855, TreeAccess=True)
context = GetGeometry(brep, AnnotationTypeFilter=3966, AtLeast=1, AtMost=2147483647, DeleteInput=False, Filter=1074081855, TreeAccess=True)
mesh_join = MeshJoin(Meshes=geo)
importepw = LBImportEPW(epw_file=downloadepw.epw_file)  # -> location, dry_bulb_temperature, dew_point_temperature, relative_humidity, wind_speed, wind_direction, direct_normal_rad, diffuse_horizontal_rad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; plug-in component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
analysisperiod = LBAnalysisPeriod(start_month="6", start_day="21", start_hour="9", end_month="6", end_day="21", end_hour="17")  # -> period, hoys, dates; plug-in component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
legendpar = LBLegendParameters(min="0", max="8", seg_count="9")  # -> leg_par; plug-in component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
sunpath = LBSunPath(location=importepw.location, hoys=analysisperiod.hoys, scale=1)  # -> report, vectors, altitudes, azimuths, hoys, sun_pts, analemma, daily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; plug-in component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
number_slider = Slider(1, range=0..10)
directsunhours = LBDirectSunHours(
    vectors=flatten(sunpath.vectors),
    geometry=flatten(mesh_join),
    context=flatten(context),
    grid_size=Slider(0.5, range=0..1),
    offset_dist=Slider(1, range=0..1),
    legend_par=legendpar,
    run=Toggle(True))  # -> report, points, results, mesh, legend, title, int_mtx; plug-in component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

# ---- group: RH_OUT:mesh
mesh = Mesh(flatten(directsunhours.mesh))
