# Grasshopper definition topoSpeckle.ghx (Grasshopper 1.0.8)
# plug-ins: Speckle 2

rendermaterial = RenderMaterial(
    Opacity="1",
    Metalness="0",
    Roughness="1",
    Diffuse=ColourSwatch(SwatchColor=RGB(201, 201, 201)),
    SelectedConstructorName="Objects.Other.RenderMaterial.ctor(System.Double,System.Double,System.Double,System.Nullable`1[System.Drawing.Color],System.Nullable`1[System.Drawing.Color])",
    SelectedTypeName="Objects.Other.RenderMaterial",
    UseSchemaTag=False,
    UserSetSchemaTag=False,
    seed="e70122511daf16d7d419")
rendermaterial_2 = RenderMaterial(
    Opacity="1",
    Metalness="0",
    Roughness="1",
    Diffuse=ColourSwatch(SwatchColor=RGB(193, 9, 235)),
    SelectedConstructorName="Objects.Other.RenderMaterial.ctor(System.Double,System.Double,System.Double,System.Nullable`1[System.Drawing.Color],System.Nullable`1[System.Drawing.Color])",
    SelectedTypeName="Objects.Other.RenderMaterial",
    UseSchemaTag=False,
    UserSetSchemaTag=False,
    seed="67d5ad2d0cfcec260a0f")
rendermaterial_3 = RenderMaterial(
    Opacity="1",
    Metalness="0",
    Roughness="1",
    Diffuse=ColourSwatch(SwatchColor=RGB(122, 122, 122)),
    SelectedConstructorName="Objects.Other.RenderMaterial.ctor(System.Double,System.Double,System.Double,System.Nullable`1[System.Drawing.Color],System.Nullable`1[System.Drawing.Color])",
    SelectedTypeName="Objects.Other.RenderMaterial",
    UseSchemaTag=False,
    UserSetSchemaTag=False,
    seed="c5104c5d109582424b59")
boundary = GetGeometry(AnnotationTypeFilter=0, AtLeast=1, AtMost=2147483647, DeleteInput=False, Filter=1074004029, TreeAccess=True)
heritage = GetGeometry(AnnotationTypeFilter=0, AtLeast=1, AtMost=2147483647, DeleteInput=False, Filter=1074004029, TreeAccess=True)
elevatedbuildings = GetGeometry(AnnotationTypeFilter=0, AtLeast=1, AtMost=2147483647, DeleteInput=False, Filter=1074004029, TreeAccess=True)
python = GhPythonScript()  # -> out
# ---------- python: Python ----------
import Rhino

my_doc = Rhino.RhinoDoc.CreateHeadless(None)
my_doc.ModelUnitSystem = Rhino.UnitSystem.Meters
Rhino.RhinoDoc.ActiveDoc = my_doc
# ---------- end python ----------
lots = GetGeometry(AnnotationTypeFilter=0, AtLeast=1, AtMost=2147483647, DeleteInput=False, Filter=1074004029, TreeAccess=True)
roads = GetGeometry(AnnotationTypeFilter=0, AtLeast=1, AtMost=2147483647, DeleteInput=False, Filter=1074004029, TreeAccess=True)
isochrone = GetGeometry(AnnotationTypeFilter=0, AtLeast=1, AtMost=2147483647, DeleteInput=False, Filter=1074004029, TreeAccess=True)
contours = GetGeometry(AnnotationTypeFilter=0, AtLeast=1, AtMost=2147483647, DeleteInput=False, Filter=1074004029, TreeAccess=True)
buildings = GetGeometry(AnnotationTypeFilter=0, AtLeast=1, AtMost=2147483647, DeleteInput=False, Filter=1074004029, TreeAccess=True)
streamid = GetString(AtLeast=1, AtMost=2147483647, TreeAccess=True)
mesh = GetGeometry(AnnotationTypeFilter=0, AtLeast=1, AtMost=2147483647, DeleteInput=False, Filter=1074004029, TreeAccess=True)
modelcurve = ModelCurve(
    BaseCurve=boundary,
    LineStyle="DDG_Lots",
    SelectedConstructorName="Objects.BuiltElements.Revit.Curve.ModelCurve.ctor(Objects.ICurve,System.String,System.Collections.Generic.List`1[Objects.BuiltElements.Revit.Parameter])",
    SelectedTypeName="Objects.BuiltElements.Revit.Curve.ModelCurve",
    UseSchemaTag=False,
    UserSetSchemaTag=False,
    seed="83844ea0e8f68458aefb")
modelcurve_2 = ModelCurve(
    BaseCurve=contours,
    LineStyle="DDG_Contours",
    SelectedConstructorName="Objects.BuiltElements.Revit.Curve.ModelCurve.ctor(Objects.ICurve,System.String,System.Collections.Generic.List`1[Objects.BuiltElements.Revit.Parameter])",
    SelectedTypeName="Objects.BuiltElements.Revit.Curve.ModelCurve",
    UseSchemaTag=False,
    UserSetSchemaTag=False,
    seed="e0b4b097939a6bbb1c78")
modelcurve_3 = ModelCurve(
    BaseCurve=lots,
    LineStyle="DDG_Lots",
    SelectedConstructorName="Objects.BuiltElements.Revit.Curve.ModelCurve.ctor(Objects.ICurve,System.String,System.Collections.Generic.List`1[Objects.BuiltElements.Revit.Parameter])",
    SelectedTypeName="Objects.BuiltElements.Revit.Curve.ModelCurve",
    UseSchemaTag=False,
    UserSetSchemaTag=False,
    seed="9c4cf08f70a3a4fac36e")
modelcurve_4 = ModelCurve(
    BaseCurve=isochrone,
    LineStyle="DDG_Isochrone",
    SelectedConstructorName="Objects.BuiltElements.Revit.Curve.ModelCurve.ctor(Objects.ICurve,System.String,System.Collections.Generic.List`1[Objects.BuiltElements.Revit.Parameter])",
    SelectedTypeName="Objects.BuiltElements.Revit.Curve.ModelCurve",
    UseSchemaTag=False,
    UserSetSchemaTag=False,
    seed="3d267380aaefc7f71d21")
modelcurve_5 = ModelCurve(
    BaseCurve=roads,
    LineStyle="DDG_Roads",
    SelectedConstructorName="Objects.BuiltElements.Revit.Curve.ModelCurve.ctor(Objects.ICurve,System.String,System.Collections.Generic.List`1[Objects.BuiltElements.Revit.Parameter])",
    SelectedTypeName="Objects.BuiltElements.Revit.Curve.ModelCurve",
    UseSchemaTag=False,
    UserSetSchemaTag=False,
    seed="e2eaedd832d63a817429")
modelcurve_6 = ModelCurve(
    BaseCurve=heritage,
    LineStyle="DDG_Parks",
    SelectedConstructorName="Objects.BuiltElements.Revit.Curve.ModelCurve.ctor(Objects.ICurve,System.String,System.Collections.Generic.List`1[Objects.BuiltElements.Revit.Parameter])",
    SelectedTypeName="Objects.BuiltElements.Revit.Curve.ModelCurve",
    UseSchemaTag=False,
    UserSetSchemaTag=False,
    seed="940580278aa221fd412a")
to_speckle = ToSpeckle(Data=flatten(buildings), preprocessGeometry=False, selectedKitName="Objects")
revittopography = RevitTopography(
    DisplayMesh=mesh,
    SelectedConstructorName="Objects.BuiltElements.Revit.RevitTopography.ctor(Objects.Geometry.Mesh,System.Collections.Generic.List`1[Objects.BuiltElements.Revit.Parameter])",
    SelectedTypeName="Objects.BuiltElements.Revit.RevitTopography",
    UseSchemaTag=False,
    UserSetSchemaTag=False,
    seed="6ab51f458b33fd551619")
account_from_server_token = AccountFromServerToken(Server="https://app.speckle.systems/", AuthToken="ff241e54658475cc2c8a3a066bc53faaf95285993a")
extend_speckle_object = ExtendSpeckleObject(SpeckleObject=to_speckle, RenderMaterial=rendermaterial_3, selectedKitName="Objects")
to_speckle_2 = ToSpeckle(Data=flatten(modelcurve_2), preprocessGeometry=False, selectedKitName="Objects")
to_speckle_3 = ToSpeckle(Data=flatten(modelcurve_3), preprocessGeometry=False, selectedKitName="Objects")
to_speckle_4 = ToSpeckle(Data=flatten(modelcurve_4), preprocessGeometry=False, selectedKitName="Objects")
to_speckle_5 = ToSpeckle(Data=flatten(modelcurve_5), preprocessGeometry=False, selectedKitName="Objects")
to_speckle_6 = ToSpeckle(Data=flatten(modelcurve_6), preprocessGeometry=False, selectedKitName="Objects")
to_speckle_7 = ToSpeckle(Data=flatten(modelcurve), preprocessGeometry=False, selectedKitName="Objects")
to_speckle_8 = ToSpeckle(Data=flatten(elevatedbuildings), preprocessGeometry=False, selectedKitName="Objects")
stream_get = StreamGet(StreamIDURL=flatten(streamid), SpeckleAccount=account_from_server_token)
to_speckle_9 = ToSpeckle(Data=flatten(revittopography), preprocessGeometry=False, selectedKitName="Objects")
extend_speckle_object_2 = ExtendSpeckleObject(SpeckleObject=to_speckle_2, RenderMaterial=rendermaterial, selectedKitName="Objects")
extend_speckle_object_3 = ExtendSpeckleObject(SpeckleObject=to_speckle_3, RenderMaterial=rendermaterial, selectedKitName="Objects")
extend_speckle_object_4 = ExtendSpeckleObject(SpeckleObject=to_speckle_4, RenderMaterial=rendermaterial_2, selectedKitName="Objects")
extend_speckle_object_5 = ExtendSpeckleObject(SpeckleObject=to_speckle_5, RenderMaterial=rendermaterial, selectedKitName="Objects")
extend_speckle_object_6 = ExtendSpeckleObject(SpeckleObject=to_speckle_6, RenderMaterial=rendermaterial, selectedKitName="Objects")
extend_speckle_object_7 = ExtendSpeckleObject(SpeckleObject=to_speckle_7, RenderMaterial=rendermaterial, selectedKitName="Objects")
extend_speckle_object_8 = ExtendSpeckleObject(SpeckleObject=to_speckle_8, RenderMaterial=rendermaterial, selectedKitName="Objects")
synchronous_sender = SynchronousSender(Data=extend_speckle_object, Stream=stream_get, Message="Buildings", UseDefaultCache=True, selectedKitName="Objects")
synchronous_sender_2 = SynchronousSender(Data=extend_speckle_object_2, Stream=stream_get, Message="Contours", UseDefaultCache=True, selectedKitName="Objects")
synchronous_sender_3 = SynchronousSender(Data=to_speckle_9, Stream=stream_get, Message="Topography", UseDefaultCache=True, selectedKitName="Objects")
synchronous_sender_4 = SynchronousSender(Data=extend_speckle_object_3, Stream=stream_get, Message="Lots", UseDefaultCache=True, selectedKitName="Objects")
synchronous_sender_5 = SynchronousSender(Data=extend_speckle_object_4, Stream=stream_get, Message="Isochrones", UseDefaultCache=True, selectedKitName="Objects")
synchronous_sender_6 = SynchronousSender(Data=extend_speckle_object_5, Stream=stream_get, Message="Roads", UseDefaultCache=True, selectedKitName="Objects")
synchronous_sender_7 = SynchronousSender(Data=extend_speckle_object_8, Stream=stream_get, Message="Boundary", UseDefaultCache=True, selectedKitName="Objects")
synchronous_sender_8 = SynchronousSender(Data=extend_speckle_object_6, Stream=stream_get, Message="Heritage", UseDefaultCache=True, selectedKitName="Objects")
synchronous_sender_9 = SynchronousSender(
    Data=extend_speckle_object_8,
    Stream=stream_get,
    Message="Buildings Elevated",
    UseDefaultCache=True,
    selectedKitName="Objects")

# ---- group: RH_OUT:Stream
txt = Text(synchronous_sender_3)
