# Grasshopper definition zoning_test.ghx (Grasshopper 1.0.8)

zoning = GetString(AtLeast=1, AtMost=2147483647, TreeAccess=True)
curves = GetGeometry(AnnotationTypeFilter=0, AtLeast=1, AtMost=2147483647, DeleteInput=False, Filter=1074004029, TreeAccess=True)
null_item = NullItem(Item=flatten(curves))  # -> NullFlags, InvalidFlags, Description
cull_pattern = CullPattern(List=flatten(curves), CullPattern=invert(null_item.InvalidFlags))
cull_pattern_2 = CullPattern(List=flatten(zoning), CullPattern=invert(null_item.InvalidFlags))
surface = Surface(cull_pattern)
data = Data(["0, 0, 0, 0", "255, 166, 163, 255", "252, 119, 110, 255", "250, 232, 197, 255", "99, 240, 245, 255", "201, 255, 249, 255", "98, 240, 245, 255", "98, 240, 245, 255", "0, 194, 237, 255", "149, 157, 194, 255"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])
data_2 = Data(["CA", "2(a)", "A", "AGB", "B", "B1", "B2", "B2", "B3", "B4"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])
keysearch = KeyValueSearch(Keys=flatten(data_2), Values=flatten(data), Search=flatten(cull_pattern_2))
sort = SortList(Keys=surface, ValuesA=surface, ValuesC=flatten(cull_pattern_2), ValuesB=keysearch)  # -> Keys, ValuesA, ValuesC, ValuesB
lng = ListLength(List=sort.ValuesA)
series = Series(Start=0, Step=Slider(0.0001, range=0..0.0001), Count=lng)
Z = UnitZ(Factor=series)  # -> expr("-x", UnitVector)
move = Move(Geometry=sort.ValuesA, Motion=Z)  # -> Geometry, Transform

# ---- group: RH_OUT:Values
txt = Text(flatten(sort.ValuesC))

# ---- group: RH_OUT:Colors
txt_2 = Text(sort.ValuesB)

# ---- group: RH_OUT:Surface
geo = Geometry(move.Geometry)
