# Grasshopper definition bushfire.ghx (Grasshopper 1.0.8)

bushfire = GetString(AtLeast=1, AtMost=2147483647, TreeAccess=True)
curves = GetGeometry(AnnotationTypeFilter=0, AtLeast=1, AtMost=2147483647, DeleteInput=False, Filter=1074004029, TreeAccess=True)
null_item = NullItem(Item=flatten(curves))  # -> NullFlags, InvalidFlags, Description
cull_pattern = CullPattern(List=flatten(curves), CullPattern=invert(null_item.InvalidFlags))
cull_pattern_2 = CullPattern(List=flatten(bushfire), CullPattern=invert(null_item.InvalidFlags))
cset = CreateSet(List=cull_pattern_2)  # -> Set, Map
lng = ListLength(List=cset.Set)  # -> expr("x-1", Length)
boundary_surfaces = BoundarySurfaces(Edges=graft(cull_pattern))  # -> flatten(Surfaces)
gradient = Gradient(LowerLimit=0, UpperLimit=lng, Parameter=cset.Map, stops=[0.15: RGB(255, 130, 160), 0.85: RGB(220, 0, 40)])

# ---- group: RH_OUT:Surface
geo = Geometry(boundary_surfaces)

# ---- group: RH_OUT:Colors
txt = Text(gradient)

# ---- group: RH_OUT:Values
txt_2 = Text(cull_pattern_2)
