# Grasshopper definition fsr.ghx (Grasshopper 1.0.8)

fsr = GetString(AtLeast=1, AtMost=2147483647, TreeAccess=True)
curves = GetGeometry(AnnotationTypeFilter=0, AtLeast=1, AtMost=2147483647, DeleteInput=False, Filter=1074004029, TreeAccess=True)
null_item = NullItem(Item=flatten(curves))  # -> NullFlags, InvalidFlags, Description
cull_pattern = CullPattern(List=flatten(fsr), CullPattern=invert(null_item.InvalidFlags))
cull_pattern_2 = CullPattern(List=flatten(curves), CullPattern=invert(null_item.InvalidFlags))
surface = Surface(cull_pattern_2)
sort = SortList(Keys=cull_pattern, ValuesA=surface)  # -> Keys, ValuesA
cset = CreateSet(List=sort.Keys)  # -> Set, Map
lng = ListLength(List=cset.Set)  # -> expr("x-1", Length)
gradient = Gradient(
    LowerLimit=0,
    UpperLimit=lng,
    Parameter=cset.Map,
    stops=[0: RGB(245, 222, 179), 0.5: RGB(210, 180, 140), 1: RGB(205, 133, 63)])

# ---- group: RH_OUT:Values
txt = Text(flatten(sort.Keys))

# ---- group: RH_OUT:Surface
geo = Geometry(sort.ValuesA)

# ---- group: RH_OUT:Colors
txt_2 = Text(gradient)
