# Grasshopper definition mls.ghx (Grasshopper 1.0.8)

mls = GetString(AtLeast=1, AtMost=2147483647, TreeAccess=True)
curves = GetGeometry(AnnotationTypeFilter=0, AtLeast=1, AtMost=2147483647, DeleteInput=False, Filter=1074004029, TreeAccess=True)
flatten = FlattenTree(Tree=mls, Path="{0}")
flatten_2 = FlattenTree(Tree=curves, Path="{0}")
null_item = NullItem(Item=flatten(curves))  # -> NullFlags, InvalidFlags, Description
cull_pattern = CullPattern(List=flatten(mls), CullPattern=invert(null_item.InvalidFlags))
cull_pattern_2 = CullPattern(List=flatten(curves), CullPattern=invert(null_item.InvalidFlags))
cset = CreateSet(List=cull_pattern)  # -> Set, Map
surface = Surface(cull_pattern_2)
lng = ListLength(List=cset.Set)  # -> expr("x-1", Length)
gradient = Gradient(
    LowerLimit=0,
    UpperLimit=lng,
    Parameter=cset.Map,
    stops=[0: RGB(240, 255, 240), 0.5: RGB(143, 188, 143), 1: RGB(46, 139, 87)])

# ---- group: RH_OUT:Values
txt = Text(flatten(cull_pattern))

# ---- group: RH_OUT:Surface
geo = Geometry(surface)

# ---- group: RH_OUT:Colors
txt_2 = Text(gradient)
