# Grasshopper definition vic_qld_zoning.ghx (Grasshopper 1.0.8)

zoning = GetString(AtLeast=1, AtMost=2147483647, TreeAccess=True)
curves = GetGeometry(AnnotationTypeFilter=0, AtLeast=1, AtMost=2147483647, DeleteInput=False, Filter=1074004029, TreeAccess=True)
null_item = NullItem(Item=flatten(curves))  # -> NullFlags, InvalidFlags, Description
cull_pattern = CullPattern(List=flatten(curves), CullPattern=invert(null_item.InvalidFlags))
cull_pattern_2 = CullPattern(List=flatten(zoning), CullPattern=invert(null_item.InvalidFlags))
surface = Surface(cull_pattern)
cset = CreateSet(List=cull_pattern_2)  # -> Set, Map
lng = ListLength(List=cset.Set)  # -> expr("x-1", Length)
lng_2 = ListLength(List=surface)
gradient = Gradient(
    LowerLimit=0,
    UpperLimit=lng,
    Parameter=cset.Map,
    stops=[0: RGB(220, 220, 220), 0.5: RGB(0, 128, 128), 1: RGB(47, 66, 244)])
sort = SortList(Keys=surface, ValuesA=surface, ValuesC=cull_pattern_2, ValuesB=gradient)  # -> Keys, ValuesA, ValuesC, ValuesB
series = Series(Start=0, Step=Slider(0.0001, range=0..0.0001), Count=lng_2)
Z = UnitZ(Factor=series)  # -> expr("-x", UnitVector)
move = Move(Geometry=sort.ValuesA, Motion=Z)  # -> Geometry, Transform

# ---- group: RH_OUT:Values
txt = Text(flatten(sort.ValuesC))

# ---- group: RH_OUT:Surface
geo = Geometry(move.Geometry)

# ---- group: RH_OUT:Colors
txt_2 = Text(sort.ValuesB)
